# Grasshopper definition modelgen_dummy.gh (Grasshopper 1.0.7)
# plug-ins: LunchBox

graph_json_by_antons_simulator = FilePath("C:\Users\testu\Desktop\MR Course 2022\tooling\graph.json")

# ---- group: Select paths
# right-click on the compoenent below and choose "Select One Existing File". then pick the graph.json from where the unity server saves it.
# right-click on the compoenent below and choose "Select a directory". Then select the Resources folder of the Unity project of the server.
path_to_save_objs = FilePath("C:\Users\testu\Desktop\API\Assets\Resources\")
graph_json = FilePath("C:\Users\testu\Desktop\API\Assets\Resources\graph.json")

# ---- group: READ JSON
ghpython_script = GhPythonScript(filepath=graph_json)  # -> out, data_dct, boundary_pts, furniture_pos, areas, furniture_angles, flatten(names), ids, edgesN1, edgesN2
# ---------- ghpython_script: Python ----------
import json
import Rhino.Geometry as rg

with open(filepath,'r') as f:
    data = json.load(f)
    
boundary_pts = []
for p in data['boundary']:
    #print(p)
    boundary_pts.append(rg.Point3d(p[0],p[1],p[2]))

furniture_pos = []
areas = []
furniture_angles = []
names = []
ids= []
for n in data['nodes']:
    #print(n)
    furniture_angles.append(n['angle'])
    names.append(n['name'])
    ids.append(n['id'])
    areas.append(n['area'])
    furniture_pos.append(rg.Point3d(n['position']['x'],n['position']['y'],n['position']['z']))

edgesN1 = []
edgesN2 = []
for e in data['edges']:
    print(e)
    edgesN1.append(e[0])
    edgesN2.append(e[1])
#print(data)
data_dct = [data]
# ---------- end ghpython_script ----------

# ----
panel = Panel(ghpython_script.out)
toggle = BooleanToggle(True)

# ---- group: VISUALIZE INPUT
panel_2 = Panel("""table
sofa
bigbed
bed1
bed2""")
ghpython_script_2 = GhPythonScript(names=ghpython_script.names, names_list=panel_2)  # -> out, ids; inputs names_list: list
# ---------- ghpython_script_2: Python ----------
ids = names_list.index(names)
# ---------- end ghpython_script_2 ----------
polyline = PolyLine(Vertices=ghpython_script.boundary_pts, Closed=True)
list_item = ListItem(List=ghpython_script.furniture_pos, Index=ghpython_script.edgesN1, Wrap=True)
list_item_2 = ListItem(List=ghpython_script.furniture_pos, Index=ghpython_script.edgesN2, Wrap=True)
list_item_3 = ListItem(List=ghpython_script.furniture_pos, Index=ghpython_script_2.ids, Wrap=True)
line = Line(StartPoint=list_item, EndPoint=list_item_2)
list_item_4 = ListItem(List=list_item_3, Index=0, Wrap=True)  # -> Item, Item1, Item2, Item3, Item4
list_item_5 = ListItem(List=ghpython_script.furniture_angles, Index=ghpython_script_2.ids, Wrap=True)
list_item_6 = ListItem(List=list_item_5, Index=0, Wrap=True)  # -> Item, Item1, Item2, Item3, Item4

# ---- group: FILTER TO ONLY INSIDE BOUNDARY
point_in_curve = PointInCurve(Point=ghpython_script.furniture_pos, Curve=polyline)  # -> Relationship, Point
cull_pattern = CullPattern(List=ghpython_script.furniture_pos, CullPattern=point_in_curve.Relationship)
cull_pattern_2 = CullPattern(List=ghpython_script.names, CullPattern=point_in_curve.Relationship)
cull_pattern_3 = CullPattern(List=ghpython_script.areas, CullPattern=point_in_curve.Relationship)
cull_pattern_4 = CullPattern(List=ghpython_script.ids, CullPattern=point_in_curve.Relationship)
ghpython_script_3 = GhPythonScript(x=ghpython_script.edgesN1, y=ghpython_script.edgesN2, z=cull_pattern_4)  # -> out, a; inputs x: Int32, y: Int32, z: list of Int32
# ---------- ghpython_script_3: Python ----------
if (x not in z) or (y not in z):
    a = False
else:
    a = True
# ---------- end ghpython_script_3 ----------
cull_pattern_5 = CullPattern(List=ghpython_script.furniture_angles, CullPattern=point_in_curve.Relationship)
cull_pattern_6 = CullPattern(List=ghpython_script.edgesN1, CullPattern=ghpython_script_3.a)
cull_pattern_7 = CullPattern(List=ghpython_script.edgesN2, CullPattern=ghpython_script_3.a)
list_item_7 = ListItem(List=ghpython_script.furniture_pos, Index=cull_pattern_7, Wrap=True)
list_item_8 = ListItem(List=ghpython_script.furniture_pos, Index=cull_pattern_6, Wrap=True)
line_2 = Line(StartPoint=list_item_8, EndPoint=list_item_7)

# ---- group: VISUALIZE INPUT / table
geometry = Geometry([<brep referenced from the Rhino model> x24, <mesh referenced from the Rhino model> x8])
point = Point(list_item_4.Item)

# ---- group: VISUALIZE INPUT / sofa
geometry_2 = Geometry([<brep referenced from the Rhino model> x14, <mesh referenced from the Rhino model> x8])
point_2 = Point(list_item_4.Item1)

# ---- group: VISUALIZE INPUT / big bed
geometry_3 = Geometry([<brep referenced from the Rhino model> x14, <mesh referenced from the Rhino model> x6])
point_3 = Point(list_item_4.Item2)

# ---- group: VISUALIZE INPUT / bed 1
geometry_4 = Geometry([<brep referenced from the Rhino model> x27, <mesh referenced from the Rhino model> x4])
point_4 = Point(list_item_4.Item3)

# ---- group: VISUALIZE INPUT / bed 2
geometry_5 = Geometry([<brep referenced from the Rhino model> x26, <mesh referenced from the Rhino model> x3])
point_5 = Point(list_item_4.Item4)

# ---- group: VISUALIZE INPUT (continued)
bounding_box = BoundingBox(Content=geometry_5, Plane=PlaneXY(0, 0, 0), UnionBox=True)  # -> Box, Box_2
bounding_box_2 = BoundingBox(Content=geometry, Plane=PlaneXY(0, 0, 0), UnionBox=True)  # -> Box, Box_2
bounding_box_3 = BoundingBox(Content=geometry_3, Plane=PlaneXY(0, 0, 0), UnionBox=True)  # -> Box, Box_2
bounding_box_4 = BoundingBox(Content=geometry_2, Plane=PlaneXY(0, 0, 0), UnionBox=True)  # -> Box, Box_2
bounding_box_5 = BoundingBox(Content=geometry_4, Plane=PlaneXY(0, 0, 0), UnionBox=True)  # -> Box, Box_2
evaluate_box = EvaluateBox(Box=bounding_box.Box, UParameter=0.5, VParameter=0.5, WParameter=0)  # -> Plane, Point, Include
evaluate_box_2 = EvaluateBox(Box=bounding_box_2.Box, UParameter=0.5, VParameter=0.5, WParameter=0)  # -> Plane, Point, Include
evaluate_box_3 = EvaluateBox(Box=bounding_box_3.Box, UParameter=0.5, VParameter=0.5, WParameter=0)  # -> Plane, Point, Include
evaluate_box_4 = EvaluateBox(Box=bounding_box_4.Box, UParameter=0.5, VParameter=0.5, WParameter=0)  # -> Plane, Point, Include
evaluate_box_5 = EvaluateBox(Box=bounding_box_5.Box, UParameter=0.5, VParameter=0.5, WParameter=0)  # -> Plane, Point, Include
vector_2pt = Vector2Pt(PointA=evaluate_box.Point, PointB=point_5, Unitize=False)  # -> Vector, Length
vector_2pt_2 = Vector2Pt(PointA=evaluate_box_2.Point, PointB=point, Unitize=False)  # -> Vector, Length
vector_2pt_3 = Vector2Pt(PointA=evaluate_box_3.Point, PointB=point_3, Unitize=False)  # -> Vector, Length
vector_2pt_4 = Vector2Pt(PointA=evaluate_box_4.Point, PointB=point_2, Unitize=False)  # -> Vector, Length
vector_2pt_5 = Vector2Pt(PointA=evaluate_box_5.Point, PointB=point_4, Unitize=False)  # -> Vector, Length
move = Move(Geometry=geometry_5, Motion=vector_2pt.Vector)  # -> Geometry, Transform
move_2 = Move(Geometry=geometry, Motion=vector_2pt_2.Vector)  # -> Geometry, Transform
move_3 = Move(Geometry=geometry_3, Motion=vector_2pt_3.Vector)  # -> Geometry, Transform
move_4 = Move(Geometry=geometry_2, Motion=vector_2pt_4.Vector)  # -> Geometry, Transform
move_5 = Move(Geometry=geometry_4, Motion=vector_2pt_5.Vector)  # -> Geometry, Transform
rotate = Rotate(Geometry=move_2.Geometry, Angle=degrees(list_item_6.Item), Plane=point)  # -> Geometry, Transform
rotate_2 = Rotate(Geometry=move_4.Geometry, Angle=degrees(list_item_6.Item1), Plane=point_2)  # -> Geometry, Transform
rotate_3 = Rotate(Geometry=move_3.Geometry, Angle=degrees(list_item_6.Item2), Plane=point_3)  # -> Geometry, Transform
rotate_4 = Rotate(Geometry=move_5.Geometry, Angle=degrees(list_item_6.Item3), Plane=point_4)  # -> Geometry, Transform
rotate_5 = Rotate(Geometry=move.Geometry, Angle=degrees(list_item_6.Item4), Plane=point_5)  # -> Geometry, Transform

# ---- group: area
number = Number(cull_pattern_3)

# ---- group: angle
number_2 = Number(cull_pattern_5)

# ---- group: boundary
curve = Curve(polyline)
point_6 = Point(ghpython_script.boundary_pts)

# ---- group: furniture pos
point_7 = Point(cull_pattern)

# ---- group: furniture ids
integer = Integer(cull_pattern_4)

# ---- group: edges id1
integer_2 = Integer(cull_pattern_6)

# ---- group: edges id 2
integer_3 = Integer(cull_pattern_7)

# ---- group: furniture name
text = Text(cull_pattern_2)

# ---- group: area
number_3 = Number(number)

# ---- group: angle
number_4 = Number(number_2)

# ---- group: boundary
point_8 = Point(point_6)
curve_2 = Curve(curve)

# ---- group: furniture name
text_2 = Text(text)

# ---- group: furniture ids
integer_4 = Integer(integer)

# ---- group: edges id1
integer_5 = Integer(integer_2)

# ---- group: furniture pos
point_9 = Point(point_7)

# ---- group: edges id 2
integer_6 = Integer(integer_3)

# ---- group: @HANG, REPLACE WITH YOUR MODEL GENERATING LOGIC
voronoi = Voronoi(Points=point_9, Boundary=curve_2, BruteForceOverride=False)
number_slider = Slider(0.3, range=0..1)
explode = Explode(Curve=voronoi, Recursive=True)  # -> Segments, Vertices
unit_z = UnitZ(Factor=Slider(3, range=0..10))
boundary_surfaces = BoundarySurfaces(Edges=curve_2)
md_slider = MDSlider(SliderMode=0, slider_value=Point(0.5, 0.5, 0.5), x_domain=Domain(0, 1), y_domain=Domain(0, 1), z_domain=Domain(0, 1))
unit_z_2 = UnitZ(Factor=Slider(0.7, range=0..1))
extrude = Extrude(Base=explode.Segments, Direction=unit_z)
evaluate_surface = EvaluateSurface(Surface=reparameterize(extrude), Point=md_slider)  # -> Point, Normal, UDirection, VDirection, Frame
division = Division(A=number_slider, B=2)
multiplication = Multiplication(A=evaluate_surface.Normal, B=division)
extrude_2 = Extrude(Base=boundary_surfaces, Direction=expr("-x", unit_z_2))
move_6 = Move(Geometry=extrude, Motion=multiplication)  # -> Geometry, Transform
reverse = Reverse(Vector=evaluate_surface.Normal)
multiplication_2 = Multiplication(A=reverse, B=number_slider)
extrude_3 = Extrude(Base=move_6.Geometry, Direction=multiplication_2)
jitter = Jitter(List=flatten(extrude_3), Jitter=1, Seed=Slider(45455, range=0..100000))  # -> Values, Indices
split_list = SplitList(List=jitter.Values, Index=Slider(3, range=0..10))  # -> ListA, ListB

# ---- group: material 1 floor as brep
brep = Brep(extrude_2)

# ---- group: material 2 Walls as brep
brep_2 = Brep(split_list.ListB)

# ---- group: material 3 glass as brep
brep_3 = Brep(split_list.ListA)

# ----
merge = Merge(Data2=flatten(brep_2), Data3=flatten(brep_3))
save = ObjectSave(
    BakeToggle=toggle,
    FileDirectory=path_to_save_objs,
    FileName="gen_glass.obj",
    GeometryObjects=brep_3,
    Layer="GH_Export",
    ObjectName="GH_Obj",
    ObjectColor=RGB(255, 255, 255),
    LayerColor=RGB(255, 255, 255))
save_2 = ObjectSave(
    BakeToggle=toggle,
    FileDirectory=path_to_save_objs,
    FileName="gen_floor.obj",
    GeometryObjects=brep,
    Layer="GH_Export",
    ObjectName="GH_Obj",
    ObjectColor=RGB(255, 255, 255),
    LayerColor=RGB(255, 255, 255))
save_3 = ObjectSave(
    BakeToggle=toggle,
    FileDirectory=path_to_save_objs,
    FileName="gen_walls.obj",
    GeometryObjects=brep_2,
    Layer="GH_Export",
    ObjectName="GH_Obj",
    ObjectColor=RGB(255, 255, 255),
    LayerColor=RGB(255, 255, 255))
save_4 = ObjectSave(
    BakeToggle=toggle,
    FileDirectory=path_to_save_objs,
    FileName="gen_all.obj",
    GeometryObjects=merge,
    Layer="GH_Export",
    ObjectName="GH_Obj",
    ObjectColor=RGB(255, 255, 255),
    LayerColor=RGB(255, 255, 255))
