# Grasshopper definition 3D_reconstruction.gh (Grasshopper 1.0.7)
# plug-ins: TT Toolbox, Pufferfish, LunchBox

# right-click on the compoenent below and choose "Select One Existing File". then pick the layout.json from where the unity server saves it.
graph_json = FilePath("C:\Users\testu\Documents\GitHub\FloorPlanGen\python\layout.json")
ghpython_script = GhPythonScript(filepath=graph_json)  # -> out, pdtype, pdlocation, pdsizes, pdedges, pdratios, boundary
# ---------- ghpython_script: Python ----------
import json
import Rhino.Geometry as rg

with open(filepath,'r') as f:
    data = json.load(f)
print(data['pdlocation'])
pdtype = data['pdtype']
pdlocation = data['pdlocation']
pdsizes = data['pdsizes']
pdedges = data['pdedges']
pdratios = data['pdratios']
boundary = data['boundary']
# ---------- end ghpython_script ----------
ghpython_script_2 = GhPythonScript()  # -> out, a, b, folder; disabled
# ---------- ghpython_script_2: Python ----------
import rhinoscriptsyntax as rs
import ghpythonlib.components as gc
import json
import os


 
folder = os.path.dirname(ghdoc.Path)
a = os.path.join(folder,"test2.xlsx")
with open(os.path.join(folder,'boundary.json'), 'r') as f:
    b = json.load(f)
# ---------- end ghpython_script_2 ----------

boolean_toggle = BooleanToggle(True)  # disabled
number_slider = Slider(3, range=0..10)  # disabled
number_slider_2 = Slider(4, range=0..10)  # disabled
number_slider_3 = Slider(5, range=0..10)  # disabled
number_slider_4 = Slider(2, range=0..10)  # disabled
read_excel_sheet = ReadExcelSheet(Run=boolean_toggle, FilePath=ghpython_script_2.a, Worksheet=number_slider, Listen=boolean_toggle)  # -> UserMessages, Columns, Rows; disabled
read_excel_sheet_2 = ReadExcelSheet(Run=boolean_toggle, FilePath=ghpython_script_2.a, Worksheet=number_slider_3, Listen=boolean_toggle)  # -> UserMessages, Columns, Rows; disabled
read_excel_sheet_3 = ReadExcelSheet(Run=boolean_toggle, FilePath=ghpython_script_2.a, Worksheet="1", Listen=boolean_toggle)  # -> UserMessages, Columns, Rows; disabled
read_excel_sheet_4 = ReadExcelSheet(Run=boolean_toggle, FilePath=ghpython_script_2.a, Worksheet=number_slider_4, Listen=boolean_toggle)  # -> UserMessages, Columns, Rows; disabled
read_excel_sheet_5 = ReadExcelSheet(Run=boolean_toggle, FilePath=ghpython_script_2.a, Worksheet=number_slider_2, Listen=boolean_toggle)  # -> UserMessages, Columns, Rows; disabled
panel = Panel(read_excel_sheet_2.Rows)  # disabled
panel_2 = Panel(read_excel_sheet_5.Rows)  # disabled
panel_3 = Panel(read_excel_sheet_3.Rows)  # disabled
panel_4 = Panel(read_excel_sheet.Rows)  # disabled
panel_5 = Panel(read_excel_sheet_4.Rows)  # disabled

curve = Curve([<curve referenced from the Rhino model> x3])
list_item = ListItem(List=curve, Index=ghpython_script.boundary, Wrap=True)
panel_6 = Panel(ghpython_script.pdratios)
panel_7 = Panel(ghpython_script.pdedges)
panel_8 = Panel(ghpython_script.pdtype)
panel_9 = Panel(ghpython_script.pdsizes)
panel_10 = Panel(ghpython_script.pdlocation)
scale = Scale(Geometry=list_item, Center=Point(0, 0, 0), Factor=Slider(10, range=0..10))  # -> Geometry, Transform
merge = Merge(
    Data1=ghpython_script.pdtype,
    Data2=ghpython_script.pdlocation,
    Data3=ghpython_script.pdsizes,
    Data4=ghpython_script.pdedges,
    Data5=ghpython_script.pdratios)
colour_swatch = ColourSwatch(SwatchColor=RGB(161, 161, 161))  # disabled
colour_swatch_2 = ColourSwatch(SwatchColor=RGB(201, 201, 201))  # disabled

number_slider_5 = Slider(4, range=0..10)
merge_2 = Merge(
    Data1=read_excel_sheet_3.Rows,
    Data2=read_excel_sheet_4.Rows,
    Data3=read_excel_sheet.Rows,
    Data4=read_excel_sheet_5.Rows,
    Data5=read_excel_sheet_2.Rows)
ghpython_script_3 = GhPythonScript(x=merge)  # -> types, location_x, location_y, size, edges, ratios; inputs x: list
# ---------- ghpython_script_3: Python ----------
__author__ = "AnthemLts"
__version__ = "2022.10.22"

import rhinoscriptsyntax as rs

types = x[0:7]
location = x[7:21]
size = x[21:28]
edges = x[28:64]
ratios = x[64:71]
ratios = ratios
location_x = []
location_y = []
for i in range(14):
    if i%2 == 0:
        location_x.append(location[i])
    else:
        location_y.append(location[i])
# ---------- end ghpython_script_3 ----------
multiplication = Multiplication(A=ghpython_script_3.ratios, B=Slider(3, range=0..10))
multiplication_2 = Multiplication(A=ghpython_script_3.size, B=Slider(25, range=0..100))
number_slider_6 = Slider(5, range=0..10)
curve_2 = Curve(scale.Geometry)
offset_curve = OffsetCurve(Curve=curve_2, Distance=Slider(5, range=0..10), Corners=1)
offset_curve_2 = OffsetCurve(Curve=curve_2, Distance=Slider(1.5, range=0..10), Corners=1)
offset_curve_3 = OffsetCurve(Curve=curve_2, Distance=Slider(3, range=0..10), Corners=1)

deconstruct_brep = DeconstructBrep(Brep=curve_2)  # -> Faces, Edges, Vertices

number_slider_7 = Slider(30, range=0..100)  # disabled
fit_curve = FitCurve()  # disabled
fit_curve_2 = FitCurve(Curve=curve_2)  # disabled
ruled_surface = RuledSurface(CurveA=fit_curve_2, CurveB=fit_curve)  # disabled
unit_z = UnitZ(Factor=number_slider_7)  # disabled
extrude = Extrude(Base=ruled_surface, Direction=unit_z)  # disabled

custom_preview = CustomPreview(Geometry=extrude, Material=colour_swatch)  # disabled

bounds_2d = Bounds2D(Coordinates=deconstruct_brep.Vertices)
deconstruct_domain² = DeconstructDomain²(Domain=bounds_2d)  # -> UMin, UMax, VMin, VMax
subtraction = Subtraction(A=deconstruct_domain².VMax, B=deconstruct_domain².VMin)
subtraction_2 = Subtraction(A=deconstruct_domain².UMax, B=deconstruct_domain².UMin)
multiplication_3 = Multiplication(A=ghpython_script_3.location_y, B=subtraction)
multiplication_4 = Multiplication(A=ghpython_script_3.location_x, B=subtraction_2)
addition = Addition(A=multiplication_3, B=deconstruct_domain².VMin)
addition_2 = Addition(A=multiplication_4, B=deconstruct_domain².UMin)
construct_point = ConstructPoint(XCoordinate=addition_2, YCoordinate=addition, ZCoordinate=0)
panel_11 = Panel(construct_point)

number_slider_8 = Slider(20, range=0..100)
number_slider_9 = Slider(5, range=0..100)
number_slider_10 = Slider(15, range=0..100)
ghpython_script_4 = GhPythonScript()  # -> out, names, new_name; inputs names: list, Type_List: list of Int32, num: Int32; disabled
# ---------- ghpython_script_4: Python ----------
import ghpythonlib.components as gc
import rhinoscriptsyntax as rs

new_name = []

if 1 in Type_List:
    names.remove('Entrance')

if 6 in Type_List:

    names.remove('Dining room')
    
for i in range(num):
    new_name.append((names[i] + '%d') % (i))
# ---------- end ghpython_script_4 ----------
ghpython_script_5 = GhPythonScript(
    scale_list=[deconstruct_domain².UMin, deconstruct_domain².UMax, deconstruct_domain².VMin, deconstruct_domain².VMax],
    typelist=ghpython_script_3.types,
    Area=multiplication_2,
    Center_x=addition_2,
    Center_y=addition,
    Aspect_Ratio=multiplication,
    Bound=offset_curve_2,
    Bound_in=curve_2,
    threshold=Slider(10, range=0..10))  # -> InCollections, MidCollections, OutCollections, names; inputs scale_list: list, typelist: list of Int32, Area: list, Center_x: list, Center_y: list, Aspect_Ratio: list, Bound: Polyline, Bound_in: Polyline
# ---------- ghpython_script_5: Python ----------
import rhinoscriptsyntax as rs
import ghpythonlib.components as gc
import math

#width = scale_list[1] - scale_list[0]
#height = scale_list[3] - scale_list[2]
#dimension = max(width,height)
scale = (255/18)**2#*(dimension/255)
namelist = ['Entray','Bathroom','Closet','Bed','Kitchen','Dining','Balcony']
names = []

def GetInnerBox(x,y,area,ratio):
    x_dimension = ((math.sqrt(scale*area/ratio))/2)
    y_dimension = (x_dimension*ratio)
    Pt_01 = gc.ConstructPoint(x-x_dimension,y-y_dimension,0)
    Pt_02 = gc.ConstructPoint(x+x_dimension,y-y_dimension,0)
    Pt_03 = gc.ConstructPoint(x+x_dimension,y+y_dimension,0)
    Pt_04 = gc.ConstructPoint(x-x_dimension,y+y_dimension,0)
    Inner_Box = [Pt_01,Pt_02,Pt_03,Pt_04]
    
    return Inner_Box

def GetMidBox(PtAll):
    Pt_11 = gc.Move(PtAll[0],'-1.5,-1.5,0')[0]
    Pt_12 = gc.Move(PtAll[1],'+1.5,-1.5,0')[0]
    Pt_13 = gc.Move(PtAll[2],'+1.5,+1.5,0')[0]
    Pt_14 = gc.Move(PtAll[3],'-1.5,+1.5,0')[0]
    Mid_Box = [Pt_11,Pt_12,Pt_13,Pt_14]
    
    return Mid_Box

def CalculateDistance(Corner,target):
    Down_Pt = gc.ProjectPoint(Corner,'0,-1,0',target)[0]
    Left_Pt = gc.ProjectPoint(Corner,'-1,0,0',target)[0]
    Up_Pt = gc.ProjectPoint(Corner,'0,1,0',target)[0]
    Right_Pt = gc.ProjectPoint(Corner,'1,0,0',target)[0]
    Dis_Down = gc.Distance(Corner,Down_Pt)
    Dis_Left = gc.Distance(Corner,Left_Pt)
    Dis_Up = gc.Distance(Corner,Up_Pt)
    Dis_Right = gc.Distance(Corner,Right_Pt)

    return Dis_Down,Dis_Left,Dis_Up,Dis_Right

def ModifyCorners(Dis_D,Dis_L,Dis_U,Dis_R,Index_a,Index_b,Index_d,PtAll):
    if 0.01< Dis_D < threshold + 0.01:
        PtAll[Index_a] = gc.Move(PtAll[Index_a],'0,-%f,0' % (Dis_D))[0]
        PtAll[Index_b] = gc.Move(PtAll[Index_b],'0,-%f,0' % (Dis_D))[0]
    if 0.01< Dis_L < threshold + 0.01:
        PtAll[Index_a] = gc.Move(PtAll[Index_a],'-%f,0,0' % (Dis_L))[0]
        PtAll[Index_d] = gc.Move(PtAll[Index_d],'-%f,0,0' % (Dis_L))[0]
    if 0.01< Dis_U < threshold + 0.01:
        PtAll[Index_a] = gc.Move(PtAll[Index_a],'0,%f,0' % (Dis_U))[0]
        PtAll[Index_b] = gc.Move(PtAll[Index_b],'0,%f,0' % (Dis_U))[0]
    if 0.01< Dis_R < threshold + 0.01:
        PtAll[Index_a] = gc.Move(PtAll[Index_a],'%f,0,0' % (Dis_R))[0]
        PtAll[Index_d] = gc.Move(PtAll[Index_d],'%f,0,0' % (Dis_R))[0]
    return PtAll

def GetCurve_init(Mid_Ptlist):
    Mid = gc.PolyLine([Mid_Ptlist[0],Mid_Ptlist[1],Mid_Ptlist[2],Mid_Ptlist[3]],True)
    Inner = gc.OffsetCurve(Mid,-1.5,gc.XYPlane('0,0,0'),1)
    Outer = gc.OffsetCurve(Mid,1.5,gc.XYPlane('0,0,0'),1)
    
    Inner_Cut = gc.RegionIntersection(Inner,Bound_in,gc.XYPlane('0,0,0'))
#    Outer_Cut = gc.RegionIntersection(Outer,Bound_in,gc.XYPlane('0,0,0'))
    return Inner_Cut,Mid,Outer

def GetCurve_rest(Mid_Ptlist,blocked):
    Mid = gc.PolyLine([Mid_Ptlist[0],Mid_Ptlist[1],Mid_Ptlist[2],Mid_Ptlist[3]],True)
    Mid_cut = gc.RegionIntersection(Mid,Bound,gc.XYPlane('0,0,0'))
    Mid_blocked = gc.RegionDifference(Mid_cut,blocked)
    Inner = gc.OffsetCurve(Mid_blocked,-1.5,gc.XYPlane('0,0,0'),1)
    Outer = gc.OffsetCurve(Mid_blocked,1.5,gc.XYPlane('0,0,0'),1)
    
#    Inner_Cut = gc.RegionIntersection(Inner,Bound_in,gc.XYPlane('0,0,0'))
#    Outer_Cut = gc.RegionIntersection(Outer,Bound_in,gc.XYPlane('0,0,0'))
    return Inner,Mid_blocked,Outer

InCollections = []
MidCollections = []
OutCollections = []

for m in range(7):
    if Aspect_Ratio[m] != 0:
        names.append(namelist[typelist[m]-1])
        n = GetInnerBox(Center_x[m],Center_y[m],Area[m],Aspect_Ratio[m])
        MidPt = GetMidBox(n)
        if m == 0:
            for i,j in enumerate(MidPt):
                DisD,DisL,DisU,DisR = CalculateDistance(j,Bound)
                if i == 0:
                    MidPt = ModifyCorners(DisD,DisL,DisU,DisR,0,1,3,MidPt)
                elif i == 1:
                    MidPt = ModifyCorners(DisD,DisL,DisU,DisR,1,0,2,MidPt)
                elif i == 2:
                    MidPt = ModifyCorners(DisD,DisL,DisU,DisR,2,3,1,MidPt)
                elif i == 3:
                    MidPt = ModifyCorners(DisD,DisL,DisU,DisR,3,2,0,MidPt)
            In,Mid,Out = GetCurve_init(MidPt)
            InCollections.append(In)
            MidCollections.append(Mid)
            OutCollections.append(Out)
        else:
            for i,j in enumerate(MidPt):
                DisD1,DisL1,DisU1,DisR1 = CalculateDistance(j,Bound)
                if i == 0:
                    MidPt = ModifyCorners(DisD1,DisL1,DisU1,DisR1,0,1,3,MidPt)
                elif i == 1:
                    MidPt = ModifyCorners(DisD1,DisL1,DisU1,DisR1,1,0,2,MidPt)
                elif i == 2:
                    MidPt = ModifyCorners(DisD1,DisL1,DisU1,DisR1,2,3,1,MidPt)
                elif i == 3:
                    MidPt = ModifyCorners(DisD1,DisL1,DisU1,DisR1,3,2,0,MidPt)
    
            for i,j in enumerate(MidPt):
                DisD1,DisL1,DisU1,DisR1 = CalculateDistance(j,Bound)
                DisD2,DisL2,DisU2,DisR2 = CalculateDistance(j,MidCollections)
                if i == 0:
                    MidPt = ModifyCorners(DisD1,DisL1,DisU1,DisR1,0,1,3,MidPt)
                    MidPt = ModifyCorners(DisD2,DisL2,DisU2,DisR2,0,1,3,MidPt)
                elif i == 1:
                    MidPt = ModifyCorners(DisD1,DisL1,DisU1,DisR1,1,0,2,MidPt)
                    MidPt = ModifyCorners(DisD2,DisL2,DisU2,DisR2,1,0,2,MidPt)
                elif i == 2:
                    MidPt = ModifyCorners(DisD1,DisL1,DisU1,DisR1,2,3,1,MidPt)
                    MidPt = ModifyCorners(DisD2,DisL2,DisU2,DisR2,2,3,1,MidPt)
                elif i == 3:
                    MidPt = ModifyCorners(DisD1,DisL1,DisU1,DisR1,3,2,0,MidPt)
                    MidPt = ModifyCorners(DisD2,DisL2,DisU2,DisR2,3,2,0,MidPt)
            
            In,Mid,Out = GetCurve_rest(MidPt,MidCollections)
            if m == 3: aa = In
            InCollections.append(In)
            MidCollections.append(Mid)
            OutCollections.append(Out)
# ---------- end ghpython_script_5 ----------
curve_3 = Curve(ghpython_script_5.MidCollections)
curve_4 = Curve(ghpython_script_5.OutCollections)

null_item = NullItem(Item=curve_3)  # -> NullFlags, InvalidFlags, Description
null_item_2 = NullItem(Item=curve_4)  # -> NullFlags, InvalidFlags, Description
dispatch = Dispatch(List=curve_3, DispatchPattern=null_item_2.NullFlags)  # -> ListA, ListB
dispatch_2 = Dispatch(List=curve_3, DispatchPattern=null_item.NullFlags)  # -> ListA, ListB
area = Area(Geometry=dispatch_2.ListB)  # -> Area, Centroid
area_2 = Area(Geometry=dispatch.ListB)  # -> Area, Centroid
sort_points = SortPoints(Points=area.Centroid)  # -> Points, Indices
list_item_2 = ListItem(List=curve_3, Index=sort_points.Indices, Wrap=True)
sort_points_2 = SortPoints(Points=area_2.Centroid)  # -> Points, Indices
list_item_3 = ListItem(List=curve_3, Index=sort_points_2.Indices, Wrap=True)

number_slider_11 = Slider(49, range=0..100)  # disabled
ghpython_script_6 = GhPythonScript(MidCurve=list_item_2, Bound_mid=offset_curve_2, OutCurve=list_item_3, ind=number_slider_11)  # -> final_walls, namelist1, namelist2, lenlist, ada_matrix, path, new; inputs MidCurve: list of Polyline, Bound_mid: Polyline, OutCurve: list, ind: Int32; disabled
# ---------- ghpython_script_6: Python ----------
import rhinoscriptsyntax as rs
import ghpythonlib.components as gc
import math
from Grasshopper.Kernel.Data import GH_Path
from Grasshopper import DataTree

namelist = ['None','Entray','Bathroom','Closet','Bed','Kitchen','Dining','Balcony','living']

Living = gc.RegionDifference(Bound_mid,MidCurve)
if gc.ListLength(Living) > 1:
    gap_list = [] 
    for i in range(gc.ListLength(Living)):
        gap_list.append(gc.Area(Living[i])[0])
    livingroom = Living[gap_list.index(max(gap_list))]
else:
    livingroom = Living
typelist = [4,4,5,2,2]
typelist.append(8)
path = "C:\\Users\\AnthemLts\\Desktop\\SciML\\%d.xlsx" % (ind)

wallsCurve_collection = []
wallsSurface_collection = []
final_walls = []
namelist1 = []
namelist2 = []
lenlist = []

for i,j in enumerate(MidCurve):
    walls_new=gc.Explode(j,True)[0]
    wallsCurve_collection.append(walls_new)
#    wallsSurface_collection.append(MidSurface.Branch(GH_Path(i)))
wallsCurve_collection.append(gc.Explode(livingroom,True)[0])

new = wallsCurve_collection[-1]

lenroom = len(wallsCurve_collection)
for i,j in enumerate(wallsCurve_collection):
    if i < lenroom - 1:
        for m,n in enumerate(j):
            ada = 0
            for k in range(i+1,lenroom):
                for h,w in enumerate(wallsCurve_collection[k]):
                    try:
                        Connec_Pt = gc.CurveXCurve(n,w)[0]
                    except:
                        Connec_Pt = None
                    if gc.ListLength(Connec_Pt) >= 2 and Connec_Pt != None:
                        if gc.Length(n) > 1 and gc.Length(w) > 1:
                            final_walls.append(n)
                            namelist1.append(typelist[i])
                            namelist2.append(typelist[k])
                            lenlist.append(gc.Length(n)*18*1000/256)
                            del wallsCurve_collection[k][h]
                            ada = 1
                        elif gc.Length(w) < 1:
                            del wallsCurve_collection[k][h]
            if ada == 0:
                final_walls.append(n)
                namelist1.append(typelist[i])
                namelist2.append(0)
                lenlist.append(gc.Length(n)*18*1000/256)
                 

ada_count = len(final_walls)
ada_initial = [[0 for i in range(ada_count)] for j in range(ada_count)]

for i,j in enumerate(final_walls):
    ada_initial[i][i] = 1
    for k in range(i+1,ada_count):
        try:
            Connec_Pt2 = gc.CurveXCurve(j,final_walls[k])[0]
        except:
            Connec_Pt2 = None
        if gc.ListLength(Connec_Pt2) >= 1 and Connec_Pt2 != None:

            ada_initial[i][k] = 1
            ada_initial[k][i] = 1

ada_matrix = DataTree[object]()
for i in range(ada_count):
    ada_matrix.AddRange(ada_initial[i],GH_Path(i))
# ---------- end ghpython_script_6 ----------
curve_5 = Curve(ghpython_script_6.final_walls)  # disabled
list_length = ListLength(List=curve_5)  # disabled
curve_6 = Curve(ghpython_script_6.new)  # disabled
series = Series(Start=0, Step=1, Count=list_length)  # disabled
merge_3 = Merge(Data1=graft(ghpython_script_6.namelist1), Data2=graft(ghpython_script_6.namelist2))  # -> simplify(Result); disabled
number_slider_12 = Slider(1, range=0..10)  # disabled
panel_12 = Panel(ghpython_script_6.namelist2)  # disabled
panel_13 = Panel(ghpython_script_6.namelist1)  # disabled
boolean_toggle_2 = BooleanToggle(False)  # disabled
boolean_toggle_3 = BooleanToggle(True)  # disabled
panel_14 = Panel(ghpython_script_6.lenlist)  # disabled
write_options = WriteOptions(
    FilePath=ghpython_script_6.path,
    ClearDataOverwrite=boolean_toggle_2,
    SaveAfterWrite=boolean_toggle_3,
    CloseAfterWrite=boolean_toggle_3,
    ColumnStartPosition=1,
    RowStartPosition=number_slider_12)  # -> UserMessages, WriteOptions; disabled
panel_15 = Panel("Sheet2")  # disabled
panel_16 = Panel("Sheet3")  # disabled
panel_17 = Panel("Sheet1")  # disabled
boolean_toggle_4 = BooleanToggle(True)  # disabled
boolean_toggle_5 = BooleanToggle(False)  # disabled
write_to_excel = WriteToExcel(
    Run=boolean_toggle_4,
    ExcelWorksheet=panel_15,
    WriteOptions=write_options.WriteOptions,
    ColumnnsOrRows=boolean_toggle_5,
    DataToWriteIntoColumns=ghpython_script_6.lenlist)  # disabled
write_to_excel_2 = WriteToExcel(
    Run=boolean_toggle_4,
    ExcelWorksheet=panel_16,
    WriteOptions=write_options.WriteOptions,
    ColumnnsOrRows=True,
    DataToWriteIntoColumns=ghpython_script_6.ada_matrix)  # disabled
write_to_excel_3 = WriteToExcel(
    Run=boolean_toggle_4,
    ExcelWorksheet=panel_17,
    WriteOptions=write_options.WriteOptions,
    ColumnnsOrRows=True,
    DataToWriteIntoColumns=merge_3)  # disabled

number_slider_13 = Slider(30, range=0..100)  # disabled
fit_curve_3 = FitCurve(Curve=curve_4)  # disabled
unit_z_2 = UnitZ(Factor=number_slider_13)  # disabled

ghpython_script_7 = GhPythonScript(MidCurve=curve_3, Bound_mid=offset_curve_2, OutCurve=ghpython_script_5.OutCollections, typelist=ghpython_script_3.types)  # -> typelist, livingroom, rooms, balcony, bal_names, door_wall; inputs MidCurve: list of Polyline, Bound_mid: Polyline, OutCurve: list, typelist: list of Int32
# ---------- ghpython_script_7: Python ----------
import rhinoscriptsyntax as rs
import ghpythonlib.components as gc
import math
from Grasshopper.Kernel.Data import GH_Path
from Grasshopper import DataTree

namelist = ['None','Entray','Bathroom','Closet','Bed','Kitchen','Dining','Balcony','living']
balcony = []
Living = gc.RegionDifference(Bound_mid,MidCurve)
rooms = []
bal_names = []
door_wall = []
for i,j in enumerate(typelist):
    if j == 7:
        balcony.append(MidCurve[i])
    else:
        rooms.append(MidCurve[i])


if gc.ListLength(Living) > 1:
    gap_list = [] 
    for i in range(gc.ListLength(Living)):
        gap_list.append(gc.Area(Living[i])[0])
        if i < gc.ListLength(Living)-1:
            typelist.append(7)
    livingroom = Living[gap_list.index(max(gap_list))]
    del Living[gap_list.index(max(gap_list))]
    for i in range(gc.ListLength(Living)):
        balcony.append(Living[i])
        bal_names.append('Balcony')
else:
    livingroom = Living

#for i,j in enumerate(rooms):
#
#    connect = gc.TrimwithRegion(livingroom,j)[0]
#    door_wall.append(connect)
# ---------- end ghpython_script_7 ----------
number_slider_14 = Slider(1.5, range=0..10)
panel_18 = Panel(ghpython_script_7.typelist)
curve_7 = Curve(ghpython_script_7.balcony)
area_3 = Area(Geometry=curve_7)  # -> Area, Centroid
text_tag_3d = TextTag3D(Location=area_3.Centroid, Text=ghpython_script_7.bal_names, Size=number_slider_9, Justification=5)
curve_8 = Curve(ghpython_script_7.door_wall)
curve_9 = Curve(ghpython_script_7.rooms)
curve_10 = Curve(ghpython_script_7.livingroom)
offset_curve_4 = OffsetCurve(Curve=curve_7, Plane=PlaneXY(0, 0, 0), Distance=number_slider_14, BothSides=0, Kinks=0, CapType=1)  # -> flatten(Offset)
trim_with_regions = TrimWithRegions(Curve=curve_2, Regions=offset_curve_4)  # -> Inside, Outside
offset_curve_5 = OffsetCurve(Curve=curve_9, Plane=PlaneXY(0, 0, 0), Distance=number_slider_14, BothSides="-1.5", Kinks=0, CapType=1)
curve_11 = Curve(trim_with_regions.Outside)
boundary_surfaces = BoundarySurfaces(Edges=offset_curve)
offset_curve_6 = OffsetCurve(Curve=offset_curve_4, Plane=PlaneXY(0, 0, 0), Distance=Slider(2, range=0..10), BothSides="-0.001", Kinks=0, CapType=1)  # -> simplify(Offset)
boundary_surfaces_2 = BoundarySurfaces(Edges=offset_curve_5)
unit_z_3 = UnitZ(Factor=Slider(3, range=0..100))
unit_z_4 = UnitZ(Factor=Slider(40, range=0..100))
extrude_2 = Extrude(Base=boundary_surfaces, Direction=unit_z_3)
region_difference = RegionDifference(CurvesA=offset_curve_6, CurvesB=offset_curve_3)
boundary_surfaces_3 = BoundarySurfaces(Edges=region_difference)
unit_z_5 = UnitZ(Factor=Slider(12, range=0..100))
null_item_3 = NullItem(Item=curve_9)  # -> NullFlags, InvalidFlags, Description
dispatch_3 = Dispatch(List=curve_9, DispatchPattern=null_item_3.NullFlags)  # -> ListA, ListB
offset_curve_7 = OffsetCurve(Curve=curve_10, Distance=Slider(0.1, range=0..10), Corners=1)
trim_with_region = TrimWithRegion(Curve=curve_2, Region=curve_10)  # -> Inside, Outside
trim_with_regions_2 = TrimWithRegions(Curve=offset_curve_7, Regions=graft(dispatch_3.ListB))  # -> Inside, Outside
trim_with_regions_3 = TrimWithRegions(Curve=curve_2, Regions=graft(dispatch_3.ListB))  # -> flatten(Inside), flatten(Outside)
curve_12 = Curve(trim_with_region.Inside)
curve_13 = Curve(trim_with_regions_2.Inside)
curve_14 = Curve(trim_with_regions_3.Outside)
curve_15 = Curve(trim_with_regions_3.Inside)
number_slider_15 = Slider(12.8, range=0..100)
number_slider_16 = Slider(12.8, range=0..100)
curve_middle = CurveMiddle(Curve=curve_13)  # -> flatten(Midpoint)
number_slider_17 = Slider(6.4, range=0..10)
curve_middle_2 = CurveMiddle(Curve=[curve_15, curve_12])  # -> flatten(Midpoint)
center_box = CenterBox(Base=curve_middle_2, X=number_slider_15, Y=number_slider_15, Z=Slider(6.4, range=0..10))
center_box_2 = CenterBox(Base=curve_middle, X=number_slider_17, Y=number_slider_17, Z=number_slider_16)
unit_z_6 = UnitZ(Factor=Slider(20, range=0..100))
unit_z_7 = UnitZ(Factor=number_slider_16)
move = Move(Geometry=center_box_2, Motion=unit_z_7)  # -> Geometry, Transform
move_2 = Move(Geometry=center_box, Motion=unit_z_6)  # -> Geometry, Transform
move_3 = Move(Geometry=extrude_2, Motion=unit_z_4)  # -> Geometry, Transform; disabled
extrude_3 = Extrude(Base=boundary_surfaces_3, Direction=unit_z_5)

curve_16 = Curve(ghpython_script_5.InCollections)
list_item_4 = ListItem(List=curve_16, Index=Slider(0, range=0..10), Wrap=True)
region_difference_2 = RegionDifference(CurvesA=curve_2, CurvesB=curve_4)
offset_curve_8 = OffsetCurve(Curve=curve_11, Plane=PlaneXY(0, 0, 0), Distance=Slider(5, range=0..10), BothSides="-0.001", Kinks=0, CapType=1)
panel_19 = Panel(ghpython_script_3.types)
boundary_surfaces_4 = BoundarySurfaces(Edges=offset_curve_8)

construct_path = ConstructPath(Indices=Slider(0, range=0..1000))

area_4 = Area(Geometry=curve_16)  # -> Area, Centroid

offset_curve_9 = OffsetCurve(Curve=region_difference_2, Distance=1.5, Corners=1)

ghpython_script_8 = GhPythonScript(
    InCurve=curve_16,
    MidCurve=curve_3,
    OutCurve=curve_4,
    Bound=curve_2,
    Bound_mid=offset_curve,
    Living=region_difference_2,
    Living_mid=offset_curve_9)  # -> NumLiving_punish, Corner_R, Area_R, Convexity_R, Ratio_R, WindowArea_R, Connectivity_R, All_R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; inputs InCurve: list of Polyline, MidCurve: list of Polyline, OutCurve: list of Polyline, Area_List: list of Int32, Type_List: list of Int32, Bound: Polyline, Bound_mid: Polyline, Living: Polyline, Living_mid: Polyline, Agent_Mask: list; disabled
# ---------- ghpython_script_8: Python ----------
import rhinoscriptsyntax as rs
import ghpythonlib.components as gc
import math

#Living = gc.RegionDifference(Bound,OutCurve)
#if gc.ListLength(Living) > 1: Living = Living[0]
#Living_mid = gc.RegionDifference(Bound_mid,MidCurve)

NumLiving_punish = 0
if gc.ListLength(Living) > 1:
    NumLiving_punish = -100

#Adj_Graph = []
Real_Graph = []
#Adj_Count = len(Graph_List)

#for i in range(0,Adj_Count,2):
#    if Graph_List[i] < Graph_List[i+1]:
#        Adj_Graph.append([Graph_List[i],Graph_List[i+1]])
#    else:
#        Adj_Graph.append([Graph_List[i+1],Graph_List[i]])

#print(Adj_Graph)
#if ind1:
#    dellist = []
#    for i,j in enumerate(Adj_Graph):
#        if j[0] == ind1:
#            dellist.append(i)
#    for n in dellist:
#        del Adj_Graph[n]
#    Adj_Graph = [[m-1 for m in Adj_Graph[i]] for i in Adj_Graph]
#    
#if ind6:
#    dellist = []
#    for i,j in enumerate(Adj_Graph):
#        if j[0] == ind6 or j[1] == ind6:
#            dellist.append(i)
#    for n in dellist:
#        del Adj_Graph[n]
#    for i,j in enumerate(Adj_Graph):
#        if j[0] > ind6 or j[1] > ind6:
#            Adj_Graph[i] = [m-1 for m in Adj_Graph[i]]


#print(Adj_Graph)
#scale = (256/18)**2

#'Bathroom'2,'Storage/closet'1,'Bed room'3,'Kitchen'1,'Balcony'2
#'Bed room','Kitchen','Bathroom','Dining room','Balcony','Entrance','Storage'
Size_Domain = [[10,32],[5,20],[5,15],[5,25],[5,25],[3,15],[10,30]]

# 1.5 as best?
Ratio_Domain = [1.2,1.8]

WindowRatio_Min = 4/(4*4*1.8)

Corner_R = []
Area_R = []
Convexity_R = []
Ratio_R = []
WindowArea_R = []
Connectivity_R = []
Adj_Bound = []
Adj_Room = []

def Eval_Corners(room):
    Edges = gc.Explode(room,True)[0]
    Edge_Count = len(Edges)
    Reward = -Edge_Count + 4
    
    return Reward
    
def Eval_Area(room,id):
    True_Area = gc.Area(room)[0]
    Target_Area = Area_List[id]
    Trans_Area = True_Area/scale
#    error = abs(True_Area-Target_Area)/scale
    punish = 0
    if Size_Domain[Type_List[id]-1][0] > Trans_Area or Size_Domain[Type_List[id]-1][1] < Trans_Area:
        punish = 10
    Reward = -punish
    
    return Reward,Trans_Area
    
def Eval_Convexity(room,realArea):
    Bounding_Box = gc.BoundingBox(room,gc.XYPlane('0,0,0'))[0]
    srf,Edges,Corners = gc.DeconstructBrep(Bounding_Box)
    Bounding_area = gc.Area(srf)[0]/scale
    Reward = -Bounding_area + realArea
    
    return Reward,Corners
    
def Eval_Ratio(cornerPt):
    X_Domain = cornerPt[2].X - cornerPt[0].X
    Y_Domain = cornerPt[2].Y - cornerPt[0].Y
    ratio = Y_Domain/X_Domain
    punish = 0
    if ratio < 1:
        ratio = 1/ratio
    error = abs(ratio-1.5)*10
    if Ratio_Domain[0] > ratio or Ratio_Domain[1] < ratio:
        punish = 10
    Reward = -error-punish
    
    return Reward
    
def Eval_WindowArea_Ratio(room,realArea):
    surf = gc.BoundarySurfaces(room)
    intersec = gc.BrepXCurve(surf,Bound)[0]
    window_area = 0
    if intersec:
        if gc.ListLength(intersec) > 1:
            for i in intersec:
                window_area += gc.Length(i)
        else:
            window_area += gc.Length(intersec)
    ratio = window_area/(realArea*(256/18))
    punish = 0
    if WindowRatio_Min > ratio:
        punish = 10
    Reward = ratio*(4*1.8)-punish
    
    return Reward

def Eval_Graph(ind):
    Bound_punish = 10
    Room_punish = 10
    Bound_connect = 0
    Room_connect = 0
    try:
        Connec_Pt_Living = gc.CurveXCurve(Bound_mid,MidCurve[ind])[0]
    except:
        Connec_Pt_Living = None
    if gc.ListLength(Connec_Pt_Living) > 0 and Connec_Pt_Living != None:
        Bound_punish = 0
        Bound_connect = 1

    for m,n in enumerate(MidCurve):
        if m != ind:
            try:
                Connec_Pt_Others = gc.CurveXCurve(MidCurve[ind],n)[0]
            except:
                Connec_Pt_Others = None
            if gc.ListLength(Connec_Pt_Others) > 0 and Connec_Pt_Others != None:
                Real_Graph.append([ind,m])
                Room_punish = 0
                Room_connect += 1
#    if ind == 0:
#        Adj_Bound = Bound_connect
#        Adj_Room = Room_connect
#    else:
    Reward = -Bound_punish - Room_punish
    
    return Reward,Bound_connect,Room_connect

Real_RoomSize = []

for i,j in enumerate(InCurve):
    Corner_R.append(Eval_Corners(j))
    Area_R_Add,real_Area = Eval_Area(j,i)
    Real_RoomSize.append(real_Area)
    Area_R.append(Area_R_Add)
    Convexity_R_Add,Corner = Eval_Convexity(j,real_Area)
    Convexity_R.append(Convexity_R_Add)
    Ratio_R.append(Eval_Ratio(Corner))
    WindowArea_R.append(Eval_WindowArea_Ratio(j,real_Area))
    Connectivity_R_Add,AdBound,AdRoom = Eval_Graph(i)
    Connectivity_R.append(Connectivity_R_Add)
    Adj_Bound.append(AdBound)
    Adj_Room.append(AdRoom)

def list_add(a,b,c,d,e,f):
    h = []
    m = 0
    for i in range(9):
        if Agent_Mask[i] == 1:
            h.append(a[m]+b[m]+c[m]+d[m]+e[m]+f[m]+100)
            m += 1
        else:
            h.append(0)
    return h
print(Real_Graph)

All_R = list_add(Corner_R,Area_R,Convexity_R,Ratio_R,WindowArea_R,Connectivity_R)

#    error = 0
#    for j in Adj_Graph:
#        connect = 0
#        for k in Real_Graph:
#            if k == j:
#                connect = 1
#        if connect == 0:
#            error += 10
#    Reward = -error
#    return Real_Graph
# ---------- end ghpython_script_8 ----------
panel_20 = Panel(ghpython_script_8.NumLiving_punish)
panel_21 = Panel(ghpython_script_8.All_R)
panel_22 = Panel(ghpython_script_8.Corner_R)
panel_23 = Panel(ghpython_script_8.Area_R)
panel_24 = Panel(ghpython_script_8.Real_RoomSize)
panel_25 = Panel(ghpython_script_8.Convexity_R)
panel_26 = Panel(ghpython_script_8.Ratio_R)
panel_27 = Panel(ghpython_script_8.WindowArea_R)
panel_28 = Panel(ghpython_script_8.Connectivity_R)

fit_curve_4 = FitCurve(Curve=curve_16)  # disabled
ruled_surface_2 = RuledSurface(CurveA=fit_curve_4, CurveB=fit_curve_3)  # disabled
extrude_4 = Extrude(Base=ruled_surface_2, Direction=unit_z_2)  # disabled

eval = Evaluate(F="Format(\"{0:0.000000000000000}\", x)", x=ghpython_script_8.All_R)
join = TextJoin(Text=eval, Join=" ")  # -> simplify(Result)
custom_preview_2 = CustomPreview(Geometry=extrude_4, Material=colour_swatch_2)  # disabled
panel_29 = Panel(join)

text_tag_3d_2 = TextTag3D(Location=area_4.Centroid, Text=ghpython_script_5.names, Size=number_slider_9, Justification=5)
extrude_5 = Extrude(Base=[boundary_surfaces_2, boundary_surfaces_4], Direction=unit_z_4)
solid_difference = SolidDifference(BrepsA=extrude_5, BrepsB=move.Geometry)
solid_difference_2 = SolidDifference(BrepsA=simplify(solid_difference), BrepsB=move_2.Geometry)

brep_edges = BrepEdges(Brep=curve_16)  # -> flatten(Naked), Interior, NonManifold; disabled
number_slider_18 = Slider(10, range=0..10)  # disabled
null_item_4 = NullItem(Item=brep_edges.Naked)  # -> NullFlags, InvalidFlags, Description; disabled
dispatch_4 = Dispatch(List=brep_edges.Naked, DispatchPattern=null_item_4.NullFlags)  # -> ListA, ListB; disabled
length = Length(Curve=dispatch_4.ListB)  # disabled
curve_middle_3 = CurveMiddle(Curve=dispatch_4.ListB)  # disabled
subtraction_3 = Subtraction(A=length, B=number_slider_18)  # disabled
xy_plane = XYPlane(Origin=curve_middle_3)  # disabled
scale_to_length = ScaleToLength(
    Curve=simplify(flatten(dispatch_4.ListB)),
    Plane=simplify(flatten(xy_plane)),
    Length=subtraction_3,
    FactorX=1,
    FactorY=1,
    FactorZ=1)  # -> Scaled, Transform; disabled
number_slider_19 = Slider(5, range=0..10)  # disabled
number_slider_20 = Slider(1.6, range=0..10)  # disabled
offset_curve_10 = OffsetCurve(Curve=scale_to_length.Scaled, Distance=number_slider_20, Corners=1)  # disabled
number_slider_21 = Slider(3.4, range=0..10)  # disabled
offset_curve_11 = OffsetCurve(Curve=scale_to_length.Scaled, Distance=number_slider_21, Corners=1)  # disabled
offset_curve_12 = OffsetCurve(Curve=scale_to_length.Scaled, Distance=number_slider_19, Corners=1)  # -> flatten(Curve); disabled
end_points = EndPoints(Curve=scale_to_length.Scaled)  # -> Start, End; disabled
end_points_2 = EndPoints(Curve=offset_curve_12)  # -> Start, End; disabled
line = Line(StartPoint=end_points.Start, EndPoint=end_points_2.Start)  # disabled
line_2 = Line(StartPoint=end_points.End, EndPoint=end_points_2.End)  # disabled

solid_union = SolidUnion(Breps=flatten(extrude_5))
solid_intersection = SolidIntersection(BrepsA=flatten(solid_union), BrepsB=move_2.Geometry)
merge_4 = Merge(Data1=solid_difference_2, Data2=move_3.Geometry, Data3=extrude_3)  # -> flatten(Result)
object_save = ObjectSave(
    BakeToggle=Toggle(True),
    FileDirectory=ghpython_script_2.folder,
    FileName="3D_model.obj",
    GeometryObjects=merge_4,
    Layer="GH_Export",
    ObjectName="GH_Obj",
    ObjectColor=RGB(255, 255, 255),
    LayerColor=RGB(255, 255, 255))
