# Grasshopper definition furniture pos generator.gh (Grasshopper 1.0.7)

# ---- group: where to save dummy json files
# right click on Path and choose "select directory".
path = FilePath("C:\Users\testu\Desktop\MR Course 2022\")

# ---- group: AREAS
table = Slider(10, range=10..30)
sofa = Slider(10, range=10..30)
master_bed = Slider(10, range=10..30)
bed1 = Slider(10, range=10..30)
bed2 = Slider(10, range=10..30)

# ---- group: USER INPUT
select_boundary = ValueList({"One": 0, "Two": 1, "Three": 2}, selected="Three")
table_angle = Slider(336, range=0..360)
sofa_angle = Slider(0, range=0..360)
big_bed_angle = Slider(0, range=0..360)
bed_1_angle = Slider(0, range=0..360)
bed_2_angle = Slider(0, range=0..360)

# ----
merge = Merge(Data1=table, Data2=sofa, Data3=master_bed, Data4=bed1, Data5=bed2)
ghpython_script = GhPythonScript(x=merge)  # -> out, a
# ---------- ghpython_script: Python ----------
import math
a = math.sqrt(x/math.pi)
# ---------- end ghpython_script ----------
curve = Curve([<curve referenced from the Rhino model> x3])
list_item = ListItem(List=curve, Index=select_boundary, Wrap=True)
curve_2 = Curve(list_item)

# ---- group: sofa
geometry = Geometry([<brep referenced from the Rhino model> x14, <mesh referenced from the Rhino model> x8])
point = Point(<point referenced from the Rhino model>)

# ---- group: bed 2
geometry_2 = Geometry([<brep referenced from the Rhino model> x26, <mesh referenced from the Rhino model> x3])
point_2 = Point(<point referenced from the Rhino model>)

# ---- group: table
geometry_3 = Geometry([<brep referenced from the Rhino model> x24, <mesh referenced from the Rhino model> x8])
point_3 = Point(<point referenced from the Rhino model>)

# ---- group: big bed
geometry_4 = Geometry([<brep referenced from the Rhino model> x14, <mesh referenced from the Rhino model> x6])
point_4 = Point(<point referenced from the Rhino model>)

# ---- group: bed 1
geometry_5 = Geometry([<brep referenced from the Rhino model> x27, <mesh referenced from the Rhino model> x4])
point_5 = Point(<point referenced from the Rhino model>)

# ----
panel = Panel("""table
sofa
bigbed
bed1
bed2""")
geometry_pipeline = GeometryPipeline(
    GroupByLayer=False,
    GroupByType=False,
    IncludeHidden=True,
    IncludeLocked=True,
    LayerFilter="adjacencies",
    NameFilter="*",
    SublayerFiltering=True,
    TypeFilter=1)
control_points = ControlPoints(Curve=curve_2)  # -> Points, Weights, Knots
bounding_box = BoundingBox(Content=geometry_2, Plane=PlaneXY(0, 0, 0), UnionBox=True)  # -> Box, Box_2
bounding_box_2 = BoundingBox(Content=geometry_3, Plane=PlaneXY(0, 0, 0), UnionBox=True)  # -> Box, Box_2
bounding_box_3 = BoundingBox(Content=geometry_4, Plane=PlaneXY(0, 0, 0), UnionBox=True)  # -> Box, Box_2
bounding_box_4 = BoundingBox(Content=geometry, Plane=PlaneXY(0, 0, 0), UnionBox=True)  # -> Box, Box_2
bounding_box_5 = BoundingBox(Content=geometry_5, Plane=PlaneXY(0, 0, 0), UnionBox=True)  # -> Box, Box_2
point_6 = Point(geometry_pipeline)
ghpython_script_2 = GhPythonScript(pts=control_points.Points, path=path)  # -> out, a; inputs pts: list of Point3d
# ---------- ghpython_script_2: Python ----------
import json
import os


a = []
for p in pts:
    a.append([float(format(p.X, '.2f')),float(format(p.Y, '.2f')),float(format(p.Z, '.2f'))])
print(json.dumps(a))

 
folder = os.path.dirname(ghdoc.Path)

with open(os.path.join(path,"boundary.json"), "w") as outfile:
    json.dump(a, outfile)
# ---------- end ghpython_script_2 ----------
merge_2 = Merge(Data1=point_3, Data2=point, Data3=point_4, Data4=point_5, Data5=point_2)
curve_3 = Curve([<curve referenced from the Rhino model> x10])
merge_3 = Merge(Data1=table_angle, Data2=sofa_angle, Data3=big_bed_angle, Data4=bed_1_angle, Data5=bed_2_angle)
evaluate_box = EvaluateBox(Box=bounding_box.Box, UParameter=0.5, VParameter=0.5, WParameter=0)  # -> Plane, Point, Include
evaluate_box_2 = EvaluateBox(Box=bounding_box_2.Box, UParameter=0.5, VParameter=0.5, WParameter=0)  # -> Plane, Point, Include
evaluate_box_3 = EvaluateBox(Box=bounding_box_3.Box, UParameter=0.5, VParameter=0.5, WParameter=0)  # -> Plane, Point, Include
evaluate_box_4 = EvaluateBox(Box=bounding_box_4.Box, UParameter=0.5, VParameter=0.5, WParameter=0)  # -> Plane, Point, Include
evaluate_box_5 = EvaluateBox(Box=bounding_box_5.Box, UParameter=0.5, VParameter=0.5, WParameter=0)  # -> Plane, Point, Include
point_in_curves = PointInCurves(Point=point_6, Curves=curve_3)  # -> Relationship, Index, Point
panel_2 = Panel(ghpython_script_2.out)
vector_2pt = Vector2Pt(PointA=evaluate_box.Point, PointB=point_2, Unitize=False)  # -> Vector, Length
vector_2pt_2 = Vector2Pt(PointA=evaluate_box_2.Point, PointB=point_3, Unitize=False)  # -> Vector, Length
vector_2pt_3 = Vector2Pt(PointA=evaluate_box_3.Point, PointB=point_4, Unitize=False)  # -> Vector, Length
vector_2pt_4 = Vector2Pt(PointA=evaluate_box_4.Point, PointB=point, Unitize=False)  # -> Vector, Length
vector_2pt_5 = Vector2Pt(PointA=evaluate_box_5.Point, PointB=point_5, Unitize=False)  # -> Vector, Length
circle = Circle(Plane=merge_2, Radius=Slider(1.6, range=0..10))
circle_2 = Circle(Plane=merge_2, Radius=ghpython_script.a)
move = Move(Geometry=geometry_2, Motion=vector_2pt.Vector)  # -> Geometry, Transform
move_2 = Move(Geometry=geometry_3, Motion=vector_2pt_2.Vector)  # -> Geometry, Transform
move_3 = Move(Geometry=geometry_4, Motion=vector_2pt_3.Vector)  # -> Geometry, Transform
move_4 = Move(Geometry=geometry, Motion=vector_2pt_4.Vector)  # -> Geometry, Transform
move_5 = Move(Geometry=geometry_5, Motion=vector_2pt_5.Vector)  # -> Geometry, Transform
boundary_surfaces = BoundarySurfaces(Edges=graft(curve_3))
point_on_curve = PointOnCurve(circle, parameter=1)
md_slider = MDSlider(
    SliderMode=0,
    slider_value=Point(0.493902439, 1, 0.5),
    x_domain=Domain(0, 1),
    y_domain=Domain(0, 1),
    z_domain=Domain(0, 1))
ghpython_script_3 = GhPythonScript(furnitures=panel, links=point_in_curves.Index)  # -> out, links_idA, links_idB, links_yes, links_names; inputs furnitures: list, links: list of Int32
# ---------- ghpython_script_3: Python ----------
links_idA = []
links_idB = []
links_yes = []
links_names = []
counter = 0
for c1 in xrange(len(furnitures)):
    #c2 = 0
    for c2 in xrange(c1+1, len(furnitures)):
        #if not f1 == f2:
        links_idA.append(c1)
        links_idB.append(c2)
        #if counter in links:
        links_yes.append(counter in links)
        links_names.append(furnitures[c1] +", " + furnitures[c2])
        counter += 1
# ---------- end ghpython_script_3 ----------
evaluate_surface = EvaluateSurface(Surface=reparameterize(boundary_surfaces), Point=md_slider)  # -> Point, Normal, UDirection, VDirection, Frame
text_tag_3d = TextTag3D(Location=point_on_curve, Text=panel, Size=Slider(0.69, range=0..1), Justification=4)
rotate = Rotate(Geometry=move_2.Geometry, Angle=degrees(table_angle), Plane=point_3)  # -> Geometry, Transform
rotate_2 = Rotate(Geometry=move_4.Geometry, Angle=degrees(sofa_angle), Plane=point)  # -> Geometry, Transform
rotate_3 = Rotate(Geometry=move_3.Geometry, Angle=degrees(big_bed_angle), Plane=point_4)  # -> Geometry, Transform
rotate_4 = Rotate(Geometry=move_5.Geometry, Angle=degrees(bed_1_angle), Plane=point_5)  # -> Geometry, Transform
rotate_5 = Rotate(Geometry=move.Geometry, Angle=degrees(bed_2_angle), Plane=point_2)  # -> Geometry, Transform
cull_pattern = CullPattern(List=ghpython_script_3.links_idA, CullPattern=ghpython_script_3.links_yes)
cull_pattern_2 = CullPattern(List=ghpython_script_3.links_idB, CullPattern=ghpython_script_3.links_yes)
text_tag_3d_2 = TextTag3D(
    Location=flatten(evaluate_surface.Point),
    Text=ghpython_script_3.links_names,
    Size=Slider(0.29, range=0..1),
    Justification=2)
list_item_2 = ListItem(List=merge_2, Index=cull_pattern, Wrap=True)
ghpython_script_4 = GhPythonScript(
    names=panel,
    pos=merge_2,
    angles=merge_3,
    areas=merge,
    idA=cull_pattern,
    idB=cull_pattern_2,
    boundary=ghpython_script_2.a,
    path=path)  # -> out, a; inputs names: list, pos: list of Point3d, angles: list, areas: list, idA: list of Int32, idB: list of Int32, boundary: list
# ---------- ghpython_script_4: Python ----------
import json
import os
nodes = []
for i in xrange(len(names)):
    p = pos[i]
    node = {
        "id": i,
        "name":names[i],
        "position":{"x":p.X,"y":p.Y,"z":p.Z},#[format(p.X, '.2f'),format(p.Y, '.2f'),format(p.Z, '.2f')],
        "angle":angles[i],
        "area":areas[i]
        }
    nodes.append(node)
links = []
for i in xrange(len(idA)):
    link = [idA[i],idB[i]]
    links.append(link)
graph = {
        "nodes":nodes,
        "edges":links,
        "boundary":boundary
        }

folder = os.path.dirname(ghdoc.Path)

with open(os.path.join(path,"graph.json"), "w") as outfile:
    json.dump(graph, outfile)
a = json.dumps(graph)
# ---------- end ghpython_script_4 ----------
list_item_3 = ListItem(List=merge_2, Index=cull_pattern_2, Wrap=True)
line = Line(StartPoint=list_item_2, EndPoint=list_item_3)
